# Grasshopper definition 3d revision to unity 2.gh (Grasshopper 1.0.7)
# plug-ins: Kangaroo2 Components, Pufferfish, Human

# Unity Slider
receive = CSharpScript()  # -> A
# ---------- receive: C# ----------
    Register(Component);

    A = sl;
# ---------- receive: C# additional code ----------
  double sl = double.NaN;

  bool registered = false;
  IGH_Component comp = null;

  void Register(IGH_Component component)
  {
    if(!registered)
    {
      Rhino.Runtime.HostUtils.RegisterNamedCallback("GH:GetNumber", aMethodName);

      comp = component;

      registered = true;
    }
  }

  void aMethodName(object sender, Rhino.Runtime.NamedParametersEventArgs args)
  {
    double values;
    if (args.TryGetDouble("number", out values))
      sl =(double)values;

    comp.ExpireSolution(true);
  }
# ---------- end receive ----------
vector_xyz = VectorXYZ(XComponent=Slider(1, range=0..1), YComponent=0, ZComponent=0)  # -> Vector, Length
# Grid 3d
# Mid point 2nd motor rotation
panel = Panel(receive)
number_slider = Slider(1, range=0..1)
# Base triangle
trigrid = Triangular(Plane=PlaneXY(0, 0, 0), Size=Slider(22, range=0..100), ExtentX=number_slider, ExtentY=number_slider)  # -> Cells, Points
explode = Explode(Curve=trigrid.Cells, Recursive=True)  # -> Segments, Vertices
item = ListItem(List=explode.Segments, Index=0, Wrap=True)  # -> Item, Item1, Item2
number_slider_2 = Slider(89, range=0..100)
number_slider_3 = Slider(13, range=0..100)
divide_curve = DivideCurve(Curve=item.Item, Count=Slider(10, range=0..100), Kinks=False)  # -> Points, Tangents, Parameters
divide_curve_2 = DivideCurve(Curve=item.Item1, Count=Slider(10, range=0..100), Kinks=False)  # -> Points, Tangents, Parameters
divide_curve_3 = DivideCurve(Curve=item.Item2, Count=Slider(10, range=0..100), Kinks=False)  # -> Points, Tangents, Parameters

list_item = ListItem(List=divide_curve.Points, Index=Slider(9, range=0..10), Wrap=True)
list_item_2 = ListItem(List=divide_curve.Points, Index=Slider(1, range=0..100), Wrap=True)
list_item_3 = ListItem(List=divide_curve_2.Points, Index=Slider(1, range=0..10), Wrap=True)
list_item_4 = ListItem(List=divide_curve_3.Points, Index=Slider(9, range=0..100), Wrap=True)
list_item_5 = ListItem(List=divide_curve_2.Points, Index=Slider(9, range=0..10), Wrap=True)
list_item_6 = ListItem(List=divide_curve_3.Points, Index=Slider(1, range=0..100), Wrap=True)
join_points1 = Point(list_item)
join_points1_2 = Point(list_item_3)
join_points1_3 = Point(list_item_4)
join_points1_4 = Point(list_item_5)
join_points1_5 = Point(list_item_6)
join_points1_6 = Point(list_item_2)
number_slider_4 = Slider(10, range=0..100)
line = Line(StartPoint=join_points1, EndPoint=join_points1_2)
line_2 = Line(StartPoint=join_points1_4, EndPoint=join_points1_5)
line_3 = Line(StartPoint=join_points1_6, EndPoint=join_points1_3)
divide_curve_4 = DivideCurve(Curve=line, Count=number_slider_4, Kinks=False)  # -> Points, Tangents, Parameters
divide_curve_5 = DivideCurve(Curve=line_3, Count=number_slider_4, Kinks=False)  # -> Points, Tangents, Parameters
divide_curve_6 = DivideCurve(Curve=line_2, Count=number_slider_4, Kinks=False)  # -> Points, Tangents, Parameters
pline = PolyLine(Vertices=divide_curve_4.Points, Closed=False)
pline_2 = PolyLine(Vertices=divide_curve_5.Points, Closed=False)
pline_3 = PolyLine(Vertices=divide_curve_6.Points, Closed=False)
rod = Rod(Polyline=pline, LengthFactor=number_slider_3, AngleFactor=1, AxialStrength=number_slider_2, BendStrength=number_slider_2)
rod_2 = Rod(
    Polyline=pline_3,
    LengthFactor=number_slider_3,
    AngleFactor=1,
    AxialStrength=number_slider_2,
    BendStrength=number_slider_2)
rod_3 = Rod(
    Polyline=pline_2,
    LengthFactor=number_slider_3,
    AngleFactor=1,
    AxialStrength=number_slider_2,
    BendStrength=number_slider_2)

list_item_7 = ListItem(List=divide_curve_4.Points, Index=Slider(5, range=0..10), Wrap=True)
list_item_8 = ListItem(List=divide_curve_5.Points, Index=Slider(5, range=0..10), Wrap=True)
list_item_9 = ListItem(List=divide_curve_6.Points, Index=Slider(5, range=0..10), Wrap=True)
join_points1_7 = Point(list_item_7)
join_points1_8 = Point(list_item_9)
join_points1_9 = Point(list_item_8)
join_points1_10 = Point(list_item_7)
number_slider_5 = Slider(1, range=0..100)
join_points1_11 = Point(list_item_9)
join_points1_12 = Point(list_item_8)
line_4 = Line(StartPoint=join_points1_7, EndPoint=join_points1_8)
line_5 = Line(StartPoint=join_points1_9, EndPoint=join_points1_10)
line_6 = Line(StartPoint=join_points1_11, EndPoint=join_points1_12)
divide_curve_7 = DivideCurve(Curve=line_5, Count=number_slider_5, Kinks=False)  # -> Points, Tangents, Parameters
divide_curve_8 = DivideCurve(Curve=line_4, Count=number_slider_5, Kinks=False)  # -> Points, Tangents, Parameters
divide_curve_9 = DivideCurve(Curve=line_6, Count=number_slider_5, Kinks=False)  # -> Points, Tangents, Parameters
pline_4 = PolyLine(Vertices=divide_curve_8.Points, Closed=False)
pline_5 = PolyLine(Vertices=divide_curve_7.Points, Closed=False)
pline_6 = PolyLine(Vertices=divide_curve_9.Points, Closed=False)
# Triangle base for loops
rod_4 = Rod(
    Polyline=[pline_5, pline_4, pline_6],
    LengthFactor=Slider(0.088, range=0..1),
    AngleFactor=1,
    AxialStrength=Slider(11, range=0..100),
    BendStrength=1)

# ----
# line between the active rods of Ji
number_slider_6 = Slider(7, range=0..10)
number_slider_7 = Slider(2, range=0..10)
list_item_10 = ListItem(List=divide_curve.Points, Index=number_slider_6, Wrap=True)
list_item_11 = ListItem(List=divide_curve_3.Points, Index=number_slider_6, Wrap=True)
list_item_12 = ListItem(List=divide_curve_2.Points, Index=number_slider_6, Wrap=True)
list_item_13 = ListItem(List=divide_curve_3.Points, Index=number_slider_7, Wrap=True)
list_item_14 = ListItem(List=divide_curve.Points, Index=number_slider_7, Wrap=True)
list_item_15 = ListItem(List=divide_curve_2.Points, Index=number_slider_7, Wrap=True)
number_slider_8 = Slider(1, range=0..10)
number_slider_9 = Slider(9, range=0..10)
list_item_16 = ListItem(List=divide_curve_4.Points, Index=number_slider_8, Wrap=True)
list_item_17 = ListItem(List=divide_curve_4.Points, Index=number_slider_9, Wrap=True)
list_item_18 = ListItem(List=divide_curve_6.Points, Index=number_slider_8, Wrap=True)
list_item_19 = ListItem(List=divide_curve_5.Points, Index=number_slider_8, Wrap=True)
list_item_20 = ListItem(List=divide_curve_5.Points, Index=number_slider_9, Wrap=True)
list_item_21 = ListItem(List=divide_curve_6.Points, Index=number_slider_9, Wrap=True)
join_points1_13 = Point(list_item_16)
join_points1_14 = Point(list_item_17)
join_points1_15 = Point(list_item_18)
join_points1_16 = Point(list_item_19)
join_points1_17 = Point(list_item_21)
join_points1_18 = Point(list_item_20)
line_7 = Line(StartPoint=join_points1_13, EndPoint=list_item_10)
line_8 = Line(StartPoint=join_points1_14, EndPoint=list_item_15)
line_9 = Line(StartPoint=join_points1_18, EndPoint=list_item_11)
line_10 = Line(StartPoint=join_points1_16, EndPoint=list_item_14)
line_11 = Line(StartPoint=join_points1_17, EndPoint=list_item_13)
line_12 = Line(StartPoint=join_points1_15, EndPoint=list_item_12)
rod_5 = Rod(
    Polyline=[line_7, line_8, line_10, line_9, line_11, line_12],
    LengthFactor=Slider(0, range=0..1),
    AngleFactor=1,
    AxialStrength=Slider(100, range=0..100),
    BendStrength=1)

# ----
# line between the active rods of Ji
number_slider_10 = Slider(8, range=0..10)
number_slider_11 = Slider(2, range=0..10)
list_item_22 = ListItem(List=divide_curve.Points, Index=number_slider_10, Wrap=True)
list_item_23 = ListItem(List=divide_curve_3.Points, Index=number_slider_10, Wrap=True)
list_item_24 = ListItem(List=divide_curve_2.Points, Index=number_slider_10, Wrap=True)
list_item_25 = ListItem(List=divide_curve_3.Points, Index=number_slider_11, Wrap=True)
list_item_26 = ListItem(List=divide_curve.Points, Index=number_slider_11, Wrap=True)
list_item_27 = ListItem(List=divide_curve_2.Points, Index=number_slider_11, Wrap=True)
list_item_28 = ListItem(List=divide_curve_4.Points, Index=Slider(3, range=0..10), Wrap=True)
list_item_29 = ListItem(List=divide_curve_4.Points, Index=Slider(7, range=0..10), Wrap=True)
list_item_30 = ListItem(List=divide_curve_6.Points, Index=Slider(3, range=0..10), Wrap=True)
list_item_31 = ListItem(List=divide_curve_5.Points, Index=Slider(3, range=0..10), Wrap=True)
list_item_32 = ListItem(List=divide_curve_5.Points, Index=Slider(7, range=0..10), Wrap=True)
list_item_33 = ListItem(List=divide_curve_6.Points, Index=Slider(7, range=0..10), Wrap=True)
join_points1_19 = Point(list_item_28)
join_points1_20 = Point(list_item_29)
join_points1_21 = Point(list_item_30)
join_points1_22 = Point(list_item_31)
join_points1_23 = Point(list_item_33)
join_points1_24 = Point(list_item_32)
line_13 = Line(StartPoint=join_points1_19, EndPoint=list_item_22)
line_14 = Line(StartPoint=join_points1_20, EndPoint=list_item_27)
line_15 = Line(StartPoint=join_points1_24, EndPoint=list_item_23)
line_16 = Line(StartPoint=join_points1_22, EndPoint=list_item_26)
line_17 = Line(StartPoint=join_points1_23, EndPoint=list_item_25)
line_18 = Line(StartPoint=join_points1_21, EndPoint=list_item_24)
rod_6 = Rod(
    Polyline=[line_13, line_16, line_15, line_14, line_17, line_18],
    LengthFactor=Slider(0.8, range=0..1),
    AngleFactor=1,
    AxialStrength=Slider(0, range=0..1000),
    BendStrength=1)

entwine = Entwine(Branch00=rod_5, Branch02=rod_6, FlattenInputs=True)  # -> flatten(Result)
# Mesh to unity
panel_2 = Panel("Fabric")

# ----
# Move anchor from here
point = Point(flatten(Point(0, 0, 0)))
point_2 = Point(Point(11, 23.16783021, 4.709552756))

move = Move(Geometry=point, Motion=vector_xyz.Vector)  # -> Geometry, Transform
xz_plane = XZPlane(Origin=move.Geometry)
rotate = Rotate(Geometry=xz_plane, Angle="45", Plane=PlaneXY(0, 0, 0))  # -> Geometry, Transform

# ----
# Feed back control logic for ros assignment A
# Motor value to degree conversion
# M2 head Rotation
# M1 Rotation
# arm Rotation M2
panel_3 = Panel("-2000")
division = Division(A=receive, B="2")
conversion_amount = Slider(0.088, range=0..0.1)
conversion_amount_2 = Slider(0.088, range=0..0.1)
conversion_amount_3 = Slider(0.088, range=0..0.1)
multiplication = Multiplication(A=receive, B=conversion_amount_2)
multiplication_2 = Multiplication(A=division, B=conversion_amount)
integer = Integer(multiplication)
integer_2 = Integer(multiplication_2)
panel_4 = Panel(integer)
panel_5 = Panel(integer_2)

subtraction = Subtraction(A=receive, B=panel_3)
absolute = Absolute(Value=subtraction)

multiplication_3 = Multiplication(A=absolute, B=conversion_amount_3)
integer_3 = Integer(multiplication_3)
panel_6 = Panel(integer_3)

rotate_2 = Rotate(Geometry=point, Angle=degrees(integer_2), Plane=rotate.Geometry)  # -> flatten(Geometry), Transform

# ----
# nodes tag
panel_7 = Panel("""M2
M1
Fix Node""")
list_item_34 = ListItem(List=graft(panel_7), Index=0, Wrap=True)  # -> flatten(Item)

# ----
# Rotation of 3 rods
crv = Curve(simplify(graft(explode.Segments)))
end = EndPoints(Curve=crv)  # -> Start, End
direction_change = BooleanToggle(True)
Z = UnitZ(Factor=1)
divide = DivideCurve(Curve=crv, Count=10, Kinks=False)  # -> Points, Tangents, Parameters
line_19 = LineSDL(Start=end.End, Direction=Z, Length=1)
merge = Merge(Data1=end.Start, Data2=end.End)
pl = ConstructPlane(Origin=end.End, XAxis=crv, YAxis=line_19)
pline_7 = PolyLine(Vertices=divide.Points, Closed=False)
pl_origin = PlaneOrigin(Base=pl, Origin=merge)
merge_2 = Merge(Data1=integer, Data2=integer_3, Data3="-90")  # -> flatten(Result)
item_2 = ListItem(List=divide.Points, Index=[1, -2], Wrap=True)
zoom_line_length = Slider(1.5, range=1..1.5)
explode_2 = Explode(Curve=pline_7, Recursive=True)  # -> Segments, Vertices
force = Slider(1000, range=0..1000)
len = Length(Curve=explode_2.Segments)
multiplication_4 = Multiplication(A=len, B=zoom_line_length)
sift = SiftPattern(List=merge_2, SiftPattern=[0, 0, 1, 1])  # -> Output0, Output1
rod_7 = Rod(Polyline=pline_7, LengthFactor=1, AngleFactor="0", AxialStrength=10, BendStrength=force)
length_line = LengthLine(Line=explode_2.Segments, Length=multiplication_4, Strength=10)
show = Show(G=pline_7)
neg = Negative(Value=sift.Output1)
dup = DuplicateData(Data=graft(merge_2), Number=2, Order=True)  # -> flatten(Data)
refresh = Button()
panel_8 = Panel(dup)

# ----
# Robotic arm Rotation point
explode_tree = ExplodeTree(Data=end.Start)  # -> Branch0, Branch1, Branch2
# this part is for further movement scenarios
# Fix point
point_3 = Point(explode_tree.Branch1)

point_4 = Point(point_3)

list_item_35 = ListItem(List=[point_4, point_2, rotate_2.Geometry], Index=0, Wrap=True)  # -> flatten(Item)
text_tag = TextTag(Location=list_item_35, Text=list_item_34)

neg_2 = Negative(Value=sift.Output0)

anchor = Anchor(Point=end.Start, Target=[point_4, point_2, rotate_2.Geometry], Strength=10000)
combine = CombineData(Input0=neg_2, Input1=neg)  # -> Result, Index
merge_3 = Merge(Data1=simplify(graft(merge_2)), Data2=simplify(graft(combine.Result)))  # -> flatten(Result)
filter = StreamFilter(Gate=direction_change, Stream0=dup, Stream1=merge_3)
shift = ShiftList(List=filter, Shift=Slider(1, range=0..10), Wrap=True)
partition = PartitionList(List=shift, Size=2)
rotate_3 = Rotate(Geometry=item_2, Angle=degrees(partition), Plane=pl_origin)  # -> Geometry, Transform
anchor_2 = Anchor(Point=item_2, Target=rotate_3.Geometry, Strength=10000)
sph = Sphere(Base=rotate_3.Geometry, Radius=0.4)
entwine_2 = Entwine(
    Branch00=flatten(show),
    Branch01=flatten([anchor_2, anchor, length_line, rod_7]),
    Branch02=entwine,
    Branch03=rod_4,
    Branch04=flatten(rod),
    Branch05=flatten(rod_3),
    Branch06=flatten(rod_2),
    FlattenInputs=True)
solver = Solver(GoalObjects=entwine_2, Reset=refresh, Threshold=1e-15, Tolerance=0.01, On=True)  # -> I, V, O

list_length = ListLength(List=entwine_2)
partition_list = PartitionList(List=solver.O, Size=list_length)
explode_tree_2 = ExplodeTree(Data=partition_list)  # -> Branch0, Branch1, Branch2, Branch3, Branch4, Branch5, Branch6
join_curves = JoinCurves(Curves=explode_tree_2.Branch0, Preserve=False)
join_curves_2 = JoinCurves(Curves=flatten(explode_tree_2.Branch3), Preserve=False)  # -> graft(Curves)
explode_3 = Explode(Curve=join_curves, Recursive=True)  # -> Segments, Vertices
explode_4 = Explode(Curve=join_curves_2, Recursive=True)  # -> Segments, Vertices
interpolate = Interpolate(Vertices=explode_3.Vertices, Degree=3, Periodic=False, KnotStyle=1)  # -> Curve, Length, Domain

join_curves_3 = JoinCurves(Curves=explode_tree_2.Branch4, Preserve=False)
join_curves_4 = JoinCurves(Curves=explode_tree_2.Branch5, Preserve=False)
join_curves_5 = JoinCurves(Curves=explode_tree_2.Branch6, Preserve=False)
explode_5 = Explode(Curve=join_curves_3, Recursive=True)  # -> Segments, Vertices
explode_6 = Explode(Curve=join_curves_4, Recursive=True)  # -> Segments, Vertices
explode_7 = Explode(Curve=join_curves_5, Recursive=True)  # -> Segments, Vertices
number_slider_12 = Slider(0, range=0..100)

list_item_36 = ListItem(List=graft(explode_5.Vertices), Index=0, Wrap=True)
list_item_37 = ListItem(List=graft(explode_6.Vertices), Index=0, Wrap=True)
list_item_38 = ListItem(List=graft(explode_7.Vertices), Index=0, Wrap=True)

interpolate_2 = Interpolate(Vertices=flatten(list_item_36), Degree=3, Periodic=False, KnotStyle=1)  # -> Curve, Length, Domain
interpolate_3 = Interpolate(Vertices=flatten(list_item_37), Degree=3, Periodic=False, KnotStyle=1)  # -> Curve, Length, Domain
interpolate_4 = Interpolate(Vertices=flatten(list_item_38), Degree=3, Periodic=False, KnotStyle=1)  # -> Curve, Length, Domain
close_curve = CloseCurve(Curve=interpolate_2.Curve, CloseType=number_slider_12, Bulge=0.5, Tolerance=0)  # -> Closed, ResultBoolean
close_curve_2 = CloseCurve(Curve=interpolate_3.Curve, CloseType=number_slider_12, Bulge=0.5, Tolerance=0)  # -> Closed, ResultBoolean

close_curve_3 = CloseCurve(Curve=interpolate_4.Curve, CloseType=number_slider_12, Bulge=0.5, Tolerance=0)  # -> Closed, ResultBoolean
patch = Patch(Curves=close_curve.Closed, Spans=20, Flexibility=1, Trim=True)
patch_2 = Patch(Curves=close_curve_2.Closed, Spans=20, Flexibility=1, Trim=True)
patch_3 = Patch(Curves=close_curve_3.Closed, Spans=20, Flexibility=1, Trim=True)
parameter_pipe_mesh = ParameterPipeMesh(
    Curve=[interpolate_2.Curve, interpolate_3.Curve, interpolate_4.Curve, explode_4.Segments, interpolate.Curve],
    Radius=Slider(0.06, range=0..0.1),
    ParametersU=[0, 0.1, 0.2, 0.3, 0.4, 0.5, 0.6, 0.7, 0.8, 0.9, 1],
    ParametersV=[0, 0.25, 0.5, 0.75, 1],
    Weighted=False,
    Lengths=False,
    Angle=Slider(2, range=0..100),
    Rotation=0,
    EndType=0,
    Triangulate=False)
mesh = Mesh([patch, patch_2, patch_3])
mesh_2 = Mesh(flatten(parameter_pipe_mesh))
flipm = FlipMesh(Mesh=mesh, VertexNormals=True, FaceNormals=True, FaceOrientation=True)
# Loops
flipm_2 = FlipMesh(Mesh=flatten(mesh_2), VertexNormals=True, FaceNormals=True, FaceOrientation=True)
mjoin = MeshJoin(Meshes=[mesh, flipm])
mjoin_2 = MeshJoin(Meshes=[flipm_2, mesh_2])
weld = WeldMesh(Mesh=mjoin, Angle=3.141592654)
weld_2 = WeldMesh(Mesh=mjoin_2, Angle=3.141592654)
mesh_3 = Mesh(weld)
custom_preview_materials = CustomPreviewMaterials(Geometry=weld_2, DiffuseColor=ColourSwatch(SwatchColor=RGB(0, 0, 0)), Transparency=Slider(0.2, range=0..1))
custom_preview_materials_2 = CustomPreviewMaterials(Geometry=mesh_3, DiffuseColor=ColourSwatch(SwatchColor=RGB(252, 0, 139)), Transparency=Slider(0.6, range=0..1))
# Mesh to unity
c_script = CSharpScript(meshList=weld_2, name="Pipe")  # inputs meshList: list of Mesh, name: String
# ---------- c_script: C# ----------
    var mesh = meshList.ToArray();

    using(var args = new Rhino.Runtime.NamedParametersEventArgs())
    {
      args.Set("mesh", mesh);
      args.Set("name", name);
      Rhino.Runtime.HostUtils.ExecuteNamedCallback("Unity:GetList", args);
    }
# ---------- end c_script ----------
c_script_2 = CSharpScript(meshList=mesh_3, name=panel_2)  # inputs meshList: list of Mesh, name: String; same code as c_script
